# Grasshopper definition auto_entourage_dev.gh (Grasshopper 1.0.7)

code = FilePath("C:\Users\Vincent Mai\Desktop\Projects\speranza_architecture\auto_entourage\src\auto_entourage_dev.py")
file = ReadFile(File=code, PerLineParse=False)
pt = Point([<point referenced from the Rhino model> x5])
crv = Curve([<curve referenced from the Rhino model> x3])
path = FilePath("C:\Users\Vincent Mai\Desktop\Projects\speranza_architecture\auto_entourage\examples\entourages\trimmed\")
python = GhPythonScript(Code=file, Path=path, Region=crv, Point=pt, Num="3", Run=Toggle(False))
panel = Panel(python)
python_2 = GhPythonScript(layer="test", run=Toggle(False))  # -> out, a
# ---------- python_2: Python ----------
__author__ = "Vincent Mai"
__version__ = "2020.09.25"

import rhinoscriptsyntax as rs
import scriptcontext as sc
import Rhino.RhinoDoc as rhDoc
import System

sc.doc = rhDoc.ActiveDoc
if run:
    if not layer:
        layer = "entourage"
    idx = sc.doc.Layers.Add(layer, System.Drawing.Color.Black)
    sc.doc.Layers.SetCurrentLayerIndex(idx, True)
    # place entourage
    sc.doc.Layers.SetCurrentLayerIndex(0, True)
else:
    rhobjs = sc.doc.Objects.FindByLayer(layer)
    if rhobjs:
        for obj in rhobjs:
            sc.doc.Objects.Delete(obj)
    sc.doc.Layers.SetCurrentLayerIndex(0, True)
    sc.doc.Layers.Delete(sc.doc.Layers.FindName(layer), True)
sc.doc = ghdoc
# ---------- end python_2 ----------
